% Simulink data dictionary servo_hub_database.sldd

Axis = Simulink.Bus(DataScope="Exported", HeaderFile="servo_hub_database_type.h")
  current_ctl_config: CurrentCtlConfig
  current_ctl_input: CurrentCtlInput
  current_ctl_output: CurrentCtlOutput
  direction_id_config: DirectionIdConfig
  direction_id_input: DirectionIdInput
  direction_id_output: DirectionIdOutput
  elec_angle_id_config: ElecAngleIdConfig
  elec_angle_id_input: ElecAngleIdInput
  elec_angle_id_output: ElecAngleIdOutput
  elec_id_sin_config: ElecIdSinConfig
  elec_id_sin_input: ElecIdSinInput
  elec_id_sin_output: ElecIdSinOutput
  input_shaping_config: InputShapingConfig
  input_shaping_input: InputShapingInput
  input_shaping_output: InputShapingOutput
  load_pos_sensor_config: LoadPosSensorConfig
  load_pos_sensor_input: LoadPosSensorInput
  load_pos_sensor_output: LoadPosSensorOutput
  mec_id_config: MecIdConfig
  mec_id_input: MecIdInput
  mec_id_output: MecIdOutput
  mit_ctl_config: MitCtlConfig
  mit_ctl_input: MitCtlInput
  mit_ctl_output: MitCtlOutput
  motor_ctl_sm_config: MotorCtlSmConfig
  motor_ctl_sm_input: MotorCtlSmInput
  motor_ctl_sm_output: MotorCtlSmOutput
  motor_pos_sensor_config: MotorPosSensorConfig
  motor_pos_sensor_input: MotorPosSensorInput
  motor_pos_sensor_output: MotorPosSensorOutput
  notch_filter_config: NotchFilterConfig
  notch_filter_input: NotchFilterInput
  notch_filter_internal: NotchFilterInternal
  notch_filter_output: NotchFilterOutput
  pmsm_config: PmsmConfig
  pole_pairs_id_config: PolePairsIdConfig
  pole_pairs_id_input: PolePairsIdInput
  pole_pairs_id_output: PolePairsIdOutput
  pos_speed_ctl_config: PosSpeedCtlConfig
  pos_speed_ctl_input: PosSpeedCtlInput
  pos_speed_ctl_output: PosSpeedCtlOutput
  reciprocal_motion_config: ReciprocalMotionConfig
  reciprocal_motion_output: ReciprocalMotionOutput
  reference_signal_config: ReferenceSignalConfig
  reference_signal_output: ReferenceSignalOutput
  sim_plant_config: SimPlantConfig
  sim_plant_input: SimPlantInput
  sim_plant_output: SimPlantOutput
  speed_obs_pll_config: SpeedObsPllConfig
  speed_obs_pll_input: SpeedObsPllInput
  speed_obs_pll_output: SpeedObsPllOutput
  tq_fc_id_config: TqFcIdConfig
  tq_fc_id_input: TqFcIdInput
  tq_fc_id_output: TqFcIdOutput

CurrentCtlConfig = Simulink.Bus(DataScope="Exported", HeaderFile="servo_hub_database_type.h")
  i_noise_A: single  % 电流采样噪声绝对值
  comp_du_V: single  % 死区补偿电压大小
  bandwidth_percentage: single  % 电流环目标带宽 %
  dt_s: single  % 电流环运行周期
  flux_wb: single  % 磁链系数
  kp_ld: single  % d轴 kp控制增益
  ki_ld: single  % d轴 ki控制增益
  kp_lq: single  % q轴 kp控制增益
  ki_lq: single  % q轴 ki控制增益
  pwm_duty_cycle_max: single  % pwm 占空比最大值
  elec_angle_compensation: single  % 电角度补偿系数
  phase_dir: int8  % UVW相序

CurrentCtlInput = Simulink.Bus(DataScope="Exported", HeaderFile="servo_hub_database_type.h")
  idq_tar_A: single[2]  % 目标id iq 电流
  iabc_now_A: single[3]  % iabc 三相当前电流反馈
  elec_theta_rad: single  % 当前电角度
  dc_bus_now_V: single  % 当前母线电压
  mode: uint8  % 电流环控制模式
  uabc_tar_V: single[3]  % 三相目标电压
  driver_temp: single  % 驱动器当前温度
  elec_angle_speed_rad_s: single  % 电角速度
  iq_offset_A: single  % iq 目标电流偏置

CurrentCtlOutput = Simulink.Bus(DataScope="Exported", HeaderFile="servo_hub_database_type.h")
  uabc_tar_comp_V: single[3]  % 死区补偿后目标三相电压
  idq_now_A: single[2]  % 当前dq轴电流
  uabc_tar_org_V: single[3]  % 补偿前目标三相电压

DirectionIdConfig = Simulink.Bus(DataScope="Exported", HeaderFile="servo_hub_database_type.h")
  elec_angle_add_rad: single  % 电角度步进的增量
  current_slope_percentage: single  % 电流上升斜率%每s
  id_tar_max_A: single  % d轴目标电流最大值

DirectionIdInput = Simulink.Bus(DataScope="Exported", HeaderFile="servo_hub_database_type.h")
  enc_counts_sum_p: int64  % 编码器位置累计值

DirectionIdOutput = Simulink.Bus(DataScope="Exported", HeaderFile="servo_hub_database_type.h")
  elec_angle_tar_rad: single  % 开环的目标电角度
  direction: int8  % 辨识的方向结果
  state_now: int8  % 运行状态
  id_tar_A: single  % d轴电流目标值

ElecAngleIdConfig = Simulink.Bus(DataScope="Exported", HeaderFile="servo_hub_database_type.h")
  id_max_A: single  % id 目标电流最大值
  dt_s: single  % 运行周期
  method: uint8  % 辨识方法
  angle_add_rad: single  % 电角度强拉增量
  wait_time_s: single  % 强拉角度等待时间
  test_angle_rad: single  % 测试拖动角度
  current_slope_percentage: single  % 电流上升斜率%每s

ElecAngleIdInput = Simulink.Bus(DataScope="Exported", HeaderFile="servo_hub_database_type.h")
  pos_now_rad: single  % 转子当前位置

ElecAngleIdOutput = Simulink.Bus(DataScope="Exported", HeaderFile="servo_hub_database_type.h")
  id_tar_A: single  % 目标d轴电流
  elec_bias_rad: single  % 电角度偏移值
  state_now: int8  % 运行状态
  elec_bias_buff_rad: single[2]  % 内部电角度偏移值缓存值
  step_num: uint8  % 内部辨识步骤

ElecIdSinConfig = Simulink.Bus(DataScope="Exported", HeaderFile="servo_hub_database_type.h")
  dt_s: single  % 运行周期
  end_fs_Hz: single  % 终止频率
  i_max_A: single  % 电气辨识最大电流
  init_fs_Hz: single  % 初始激励频率
  target_time_s: single  % 激励信号持续时间
  u_max_V: single  % 电气辨识最大电压
  wait_time_s: single  % 激励信号自动调整等待时间

ElecIdSinInput = Simulink.Bus(DataScope="Exported", HeaderFile="servo_hub_database_type.h")
  i_abc_now_A: single[3]  % 当前三相电流

ElecIdSinOutput = Simulink.Bus(DataScope="Exported", HeaderFile="servo_hub_database_type.h")
  state_now: int8  % 激励信号状态标志位
  u_abc_tar_V: single[3]  % 三相目标电压
  u_alpha_now_V: single  % alpha轴当前电压
  i_alpha_now_A: single  % alpha轴当前电流

InputShapingConfig = Simulink.Bus(DataScope="Exported", HeaderFile="servo_hub_database_type.h")
  wn_Hz: single  % 末端振动抑制的频率
  run_frq_Hz: single  % 模块运行频率
  enable: uint8  % 使能末端振动抑制开关

InputShapingInput = Simulink.Bus(DataScope="Exported", HeaderFile="servo_hub_database_type.h")
  pos_cmd_p: int64  % 指令目标位置
  pos_cmd_p_init: int64  % 指令目标位置初始值

InputShapingOutput = Simulink.Bus(DataScope="Exported", HeaderFile="servo_hub_database_type.h")
  pos_cmd_shaping_p: int64  % 整形后指令目标位置

LoadPosSensorConfig = Simulink.Bus(DataScope="Exported", HeaderFile="servo_hub_database_type.h")
  enc_line_p_n: uint32  % 编码器分辨率
  init_pos_p: int64  % 编码器初始位置
  dir: int8  % 计数方向

LoadPosSensorInput = Simulink.Bus(DataScope="Exported", HeaderFile="servo_hub_database_type.h")
  enc_counts_now_p: uint32  % 编码器当前单圈位置脉冲数

LoadPosSensorOutput = Simulink.Bus(DataScope="Exported", HeaderFile="servo_hub_database_type.h")
  enc_sum_p: int64  % 编码器累计脉冲值

MecIdConfig = Simulink.Bus(DataScope="Exported", HeaderFile="servo_hub_database_type.h")
  dt_s: single  % 运行周期
  end_fs_Hz: single  % 扫描终止频率
  start_fs_Hz: single  % 扫描起始频率
  target_time_s: single  % 激励信号持续时间
  i_max_A: single  % 辨识过程中最大目标力矩电流iq
  search_speed_max_rad_s: single  % 辨识过程中搜索频率的最大转速
  wait_time_s: single  % 搜索等待时间
  signal_type: uint8  % 激励信号类型

MecIdInput = Simulink.Bus(DataScope="Exported", HeaderFile="servo_hub_database_type.h")
  speed_now_rad_s: single  % 当前速度

MecIdOutput = Simulink.Bus(DataScope="Exported", HeaderFile="servo_hub_database_type.h")
  iq_tar_A: single  % 目标力矩电流
  state_now: int8  % 激励信号状态标志位

MitCtlConfig = Simulink.Bus(DataScope="Exported", HeaderFile="servo_hub_database_type.h")
  kp_pos_NM_rad: single  % 位置刚度
  kd_spd_NM_rad_s: single  % 速度阻尼
  enc_line_inv_p_n: single  % 编码器分辨率倒数
  kt_NM_A: single  % 转矩常数

MitCtlInput = Simulink.Bus(DataScope="Exported", HeaderFile="servo_hub_database_type.h")
  tq_set_NM: single  % 前馈力矩电流
  pos_tar_p: int64  % 目标位置
  pos_now_p: int64  % 当前位置
  iq_max_A: single  % q轴最大输出电流
  speed_tar_p_s: single  % 目标速度
  speed_now_rad_s: single  % 当前速度

MitCtlOutput = Simulink.Bus(DataScope="Exported", HeaderFile="servo_hub_database_type.h")
  iq_tar_A: single  % 目标q轴电流

MotorCtlSmConfig = Simulink.Bus(DataScope="Exported", HeaderFile="servo_hub_database_type.h")
  mode: int8  % 运行模式
  under_voltage_protection_V: single  % 欠压保护阈值
  over_voltage_protection_V: single  % 过压保护阈值
  over_speed_protection_rad_s: single  % 过速保护阈值
  under_temperature_protection_d: single  % 欠温保护阈值
  over_temperature_protection_d: single  % 过温保护阈值
  position_following_error_protection: int32  % 位置跟随误差保护阈值
  error_enable: uint32  % 保护生效
  over_current_protection_A: single  % 过流保护阈值

MotorCtlSmInput = Simulink.Bus(DataScope="Exported", HeaderFile="servo_hub_database_type.h")
  motor_enable: uint8  % 电机使能控制指令
  hw_ready_state: uint8  % 硬件准备的状态

MotorCtlSmOutput = Simulink.Bus(DataScope="Exported", HeaderFile="servo_hub_database_type.h")
  state: int8  % 运行状态
  error: uint32  % 错误代码
  warning: uint32  % 警告代码
  mode_now: int8  % 当前运行模式
  motor_enable_last: uint8  % 电机使能控制上一个周期的值
  state_last: int8  % 上一个周期运行状态

MotorPosSensorConfig = Simulink.Bus(DataScope="Exported", HeaderFile="servo_hub_database_type.h")
  enc_line_p_n: uint32  % 编码器分辨率
  init_pos_p: int64  % 编码器初始位置
  pn: uint32  % 电机极对数
  elec_angle_bias_rad: single  % 电角度偏移值
  dir: int8  % 计数方向

MotorPosSensorInput = Simulink.Bus(DataScope="Exported", HeaderFile="servo_hub_database_type.h")
  enc_counts_now_p: uint32  % 编码器当前单圈位置脉冲数

MotorPosSensorOutput = Simulink.Bus(DataScope="Exported", HeaderFile="servo_hub_database_type.h")
  enc_sum_p: int64  % 编码器累计脉冲值
  elec_angle_now_rad: single  % 电角度当前值

NotchFilterConfig = Simulink.Bus(DataScope="Exported", HeaderFile="servo_hub_database_type.h")
  frq: single[6]  % 陷波滤波器频率
  width: single[6]  % 陷波滤波器宽度
  depth: single[6]  % 陷波滤波器深度

NotchFilterInput = Simulink.Bus(DataScope="Exported", HeaderFile="servo_hub_database_type.h")
  iq_tar_A: single  % 速度环输出目标电流

NotchFilterInternal = Simulink.Bus(DataScope="Exported", HeaderFile="servo_hub_database_type.h")
  u0: single[6]  % 前馈系数0
  u1: single[6]  % 前馈系数1
  u2: single[6]  % 前馈系数2
  y0: single[6]  % 反馈系数0
  y1: single[6]  % 反馈系数1

NotchFilterOutput = Simulink.Bus(DataScope="Exported", HeaderFile="servo_hub_database_type.h")
  iq_tar_filter_A: single  % 滤波后的目标电流

PmsmConfig = Simulink.Bus(DataScope="Exported", HeaderFile="servo_hub_database_type.h")
  b: single  % 速度阻尼系数
  fc: single  % 静摩擦大小
  flux: single  % 磁链系数
  j: single  % 转子惯量
  ld: single  % d定子电感
  lq: single  % q定子电感
  peak_current: single  % 电机峰值电流
  pn: single  % 极对数
  r: single  % 定子电阻
  rated_current: single  % 电机额定电流
  speed_max_rpm: single  % 电机最大转速
  tp_s: single  % 位置环运行周期
  tc_s: single  % 电流环运行周期
  enc_line_p_n: uint32  % 编码器分辨率
  kt: single  % 转矩常数

PolePairsIdConfig = Simulink.Bus(DataScope="Exported", HeaderFile="servo_hub_database_type.h")
  elec_angle_add: single  % 电角度步进的增量
  enc_line_p_n: uint32  % 编码器分辨率
  id_tar_max_A: single  % d轴目标电流最大值
  current_slope_percentage: single  % 电流上升斜率%每s

PolePairsIdInput = Simulink.Bus(DataScope="Exported", HeaderFile="servo_hub_database_type.h")
  enc_counts_sum_p: int64  % 编码器位置累计值

PolePairsIdOutput = Simulink.Bus(DataScope="Exported", HeaderFile="servo_hub_database_type.h")
  pn_id: uint32  % 极对数辨识结果
  state_now: int8  % 运行状态
  elec_angle_tar_rad: single  % 电角度目标值
  id_tar_A: single  % d轴电流目标值

PosSpeedCtlConfig = Simulink.Bus(DataScope="Exported", HeaderFile="servo_hub_database_type.h")
  aff: single  % 加速度前馈系数
  vff: single  % 速度前馈系数
  enc_line_inv_p_n: single  % 编码器分辨率倒数
  j_kt: single  % 惯性系数
  ki_s: single  % 速度环积分系数
  kp_p: single  % 位置环比例系数
  kp_s: single  % 速度环比例系数
  speed_max_rad_s: single  % 最大目标速度限制
  tp_s: single  % 位置速度环运行周期
  mode: single  % 运行模式
  dob_wn_Hz: single  % 负载扰动观测器带宽
  dob_enable: uint8  % 负载扰动观测使能开关
  dynamic_integration_enable: uint8  % 速度环动态积分使能

PosSpeedCtlInput = Simulink.Bus(DataScope="Exported", HeaderFile="servo_hub_database_type.h")
  pos_tar_p: int64  % 目标位置
  pos_now_p: int64  % 当前位置
  iq_max_A: single  % 最大目标q轴电流
  speed_tar_p_s: single  % 目标速度
  acc_tar_p_ss: single  % 目标加速度
  speed_now_rad_s: single  % 当前转速
  position_offset_p: int64  % 目标位置偏置
  speed_offset_p_s: single  % 目标速度偏置

PosSpeedCtlOutput = Simulink.Bus(DataScope="Exported", HeaderFile="servo_hub_database_type.h")
  iq_tar_A: single  % 目标q轴电流
  pos_ctl_error_p: int32  % 当前位置控制误差
  dob_iq_com_A: single  % 负载扰动补偿电流

ReciprocalMotionConfig = Simulink.Bus(DataScope="Exported", HeaderFile="servo_hub_database_type.h")
  pos_tar1_p: int64  % 目标位置1
  pos_tar2_p: int64  % 目标位置2
  dwell_time_s: single  % 等待时间
  profile_velocity_p_s: single  % 轮廓速度
  profile_acc_p_ss: single  % 轮廓加速度
  profile_dec_p_ss: single  % 轮廓减速度
  dt_s: single  % 运行周期

ReciprocalMotionOutput = Simulink.Bus(DataScope="Exported", HeaderFile="servo_hub_database_type.h")
  pos_tar_p: int64  % 规划位置
  v_tar_p_s: single  % 规划速度
  acc_tar_p_ss: single  % 规划加速度
  state_now: int8  % 规划器状态

ReferenceSignalConfig = Simulink.Bus(DataScope="Exported", HeaderFile="servo_hub_database_type.h")
  dt_s: single  % 运行周期
  signal_type: uint8  % 信号类型
  amp: single  % 信号幅值
  frq_Hz: single  % 运行频率
  bias: single  % 信号偏移
  signal_target: uint8  % 信号激励目标
  signal_start_pos: int64  % 参考信号启动位置

ReferenceSignalOutput = Simulink.Bus(DataScope="Exported", HeaderFile="servo_hub_database_type.h")
  signal_out: single  % 参考信号输出
  signal_pos: int64  % 参考信号输出位置
  signal_vel: single  % 参考信号输出速度
  signal_acc: single  % 参考信号输出加速度

SimPlantConfig = Simulink.Bus(DataScope="Exported", HeaderFile="servo_hub_database_type.h")
  b: single  % 速度阻尼系数
  fc: single  % 静摩擦大小
  flux: single  % 磁链系数
  kt: single  % 转矩常数
  j: single  % 转子惯量
  ld: single  % d定子电感
  lq: single  % q定子电感
  peak_current_A: single  % 电机峰值电流
  pn: single  % 极对数
  r: single  % 定子电阻
  rated_current_A: single  % 电机额定电流
  speed_max_rpm: single  % 电机最大转速
  dt_s: single  % 虚拟电机模型运行周期
  enc_line_p_n: uint32  % 编码器分辨率
  j_inv: single  % 转子惯量倒数
  ld_inv: single  % d定子电感倒数
  lq_inv: single  % q定子电感倒数
  enc_line_init_pos_P: int64  % 编码器初始位置
  enc_noise: single  % 编码器传感器噪声

SimPlantInput = Simulink.Bus(DataScope="Exported", HeaderFile="servo_hub_database_type.h")
  uabc_tar_V: single[3]  % 虚拟模型三相电压输入
  tl_Nm: single  % 虚拟模型转矩输入

SimPlantOutput = Simulink.Bus(DataScope="Exported", HeaderFile="servo_hub_database_type.h")
  iabc_now_A: single[3]  % 虚拟模型三相电流输出
  enc_counts_P: uint32  % 虚拟模型编码器单圈值
  hall_state: uint8  % 虚拟模型霍尔传感器输出
  dc_bus_V: single  % 虚拟母线电源电压输出

SpeedObsPllConfig = Simulink.Bus(DataScope="Exported", HeaderFile="servo_hub_database_type.h")
  tp_s: single  % 运行周期
  wn_Hz: single  % 速度观测带宽
  enc_line_inv_p_n: single  % 编码器分辨率倒数
  speed_obs_max_rad_s: single  % 最大目标速度限制

SpeedObsPllInput = Simulink.Bus(DataScope="Exported", HeaderFile="servo_hub_database_type.h")
  pos_now_p: int64  % 电机当前位置

SpeedObsPllOutput = Simulink.Bus(DataScope="Exported", HeaderFile="servo_hub_database_type.h")
  ev_rad_s: single  % 观测转速

TqFcIdConfig = Simulink.Bus(DataScope="Exported", HeaderFile="servo_hub_database_type.h")
  enc_line_p_n: uint32  % 编码器分辨率
  iq_com_enable: uint8  % 使能负载扰动补偿开关
  tq_com_enable: uint8  % 使能转矩脉动补偿开关
  fc_com_enable: uint8  % 使能摩擦补偿开关
  fc_p_com: single  % 摩擦补偿正方向补偿值
  fc_n_com: single  % 摩擦补偿负方向补偿值

TqFcIdInput = Simulink.Bus(DataScope="Exported", HeaderFile="servo_hub_database_type.h")
  iq_com_A: single  % 负载扰动观测器补偿值
  pos_abs_p: uint32  % 当前转子绝对位置
  pos_init_p: int64  % 电机初始位置
  start: uint8  % 启动辨识指令

TqFcIdOutput = Simulink.Bus(DataScope="Exported", HeaderFile="servo_hub_database_type.h")
  pos_cmd_p: int64  % 位置指令值
  state_now: int8  % 当前辨识状态

kAxis = Simulink.Signal(StorageClass="ExportToFile", HeaderFile="servo_hub_database_define.h", DefinitionFile="servo_hub_database_define.c", DataType="Bus: Axis")